# Dynamo graph FurtherLibrary_1_CreateBookcaseScenario.dyn (Dynamo 2.0.3.8810)

# group: FurtherLibrary_1_CreateBookcaseScenario.dyn
# note: Written by Thomas Corrie
# for BiLT Europe Presentation
# "Further Optimizing an Architect's Bookshelf"
# 12th October 2019

# group: Dictionary Keys
code_block = CodeBlock()
# ---------- code_block.designscript (4 lines) ----------
[
"scenario",
"bookcases"
];
# ----------------------------------------

# group: Dictionary Keys
code_block_2 = CodeBlock()
# ---------- code_block_2.designscript (14 lines) ----------
[
"revitFilename",
"datetime",
"username",
"computer",
"dynamoShort",
"dynamoLong",
"platform",
"numBookcases",
"description",
"dynamoFilename",
"combinations",
"scenarioName"
];
# ----------------------------------------

# group: Get Revit Document Name
current = Document.Current()
filePath = Document.FilePath(document=current)
string = StringInput("\")
string_2 = StringInput(".")
split = String.Split(str=filePath, separater0=string, separater1=string_2)
code_block_3 = CodeBlock(x=split) { x[-2]; }

# group: Select Shelf Family Instances in Revit
select_model_elements = DSModelElementsSelection()  # 7 picked in the model

# group: Turn into List for Singletons
list_create = List.Create(item0=select_model_elements)
flatten = List.Flatten(list=list_create)

# group: Mark Value (numeric) and Sort Bookcases
string_3 = StringInput("Mark")
getParameterValueByName = Element.GetParameterValueByName(element=flatten, parameterName=string_3)
toNumber = String.ToNumber(str=getParameterValueByName)
sortByKey = List.SortByKey(list=flatten, keys=toNumber)

# group: Subcategory Names for Shelves
code_block_4 = CodeBlock { ["Shelf-Fixed","Shelf-Flexible","Shelf-Empty"]; }
flexible_shelf_name = StringInput("Shelf-Flexible")
none_shelf_name = StringInput("Shelf-None")

# group: Python to Get Shelf Solids by Subcategory
python_script = Python(IN[0]=sortByKey.sorted_list, IN[1]=code_block_4)
# ---------- python_script.python (40 lines) ----------
# Enable Python support and load DesignScript library and Revit nodes and services
import clr
clr.AddReference('RevitAPI')
from Autodesk.Revit.DB import *
clr.AddReference('ProtoGeometry')
from Autodesk.DesignScript.Geometry import *
clr.AddReference('RevitNodes')
import Revit
clr.ImportExtensions(Revit.GeometryConversion)
clr.AddReference("RevitServices")
import RevitServices
from RevitServices.Persistence import DocumentManager
# Document
doc = DocumentManager.Instance.CurrentDBDocument
# IN
els = UnwrapElement(IN[0]) # Unwrap family instances
subcats = IN[1] # names of subcategories
# Lists
solids = []
subCatsOut = []
# Options
geomOptions = Options()
# Loop through elements
for e in els:
	solids.append([]) # Add 
	subCatsOut.append([])
	geoms = e.get_Geometry(geomOptions) # Get the geometry from the element
	enum = geoms.GetEnumerator() ; enum.MoveNext() # Enumerator
	geom = enum.Current.GetInstanceGeometry()
	for g in geom:
		if g != None and g.Faces.Size != 0 and g.Edges.Size != 0:
			graphics = doc.GetElement(g.GraphicsStyleId)
			if graphics != None:
				for s in subcats:
					if s == doc.GetElement(g.GraphicsStyleId).GraphicsStyleCategory.Name:
						sol = g.Convert()
						solids[-1].append(sol)
						subCatsOut[-1].append(s)

OUT = solids, subCatsOut
# ----------------------------------------
code_block_5 = CodeBlock(x=python_script) { x[0]; x[1]; }

# group: Sort Shelves by Height from Bottom to Top
centroid = Solid.Centroid(solid=code_block_5.out0)
Z = Point.Z(point=centroid)
sortByKey_2 = List.SortByKey(list=code_block_5.out0@L2, keys=Z@L2)
sortByKey_3 = List.SortByKey(list=code_block_5.out1@L2, keys=Z@L2)

# group: Get Location and Orientation of Shelf
location = FamilyInstance.Location(familyInstance=sortByKey.sorted_list)
facingOrientation = FamilyInstance.FacingOrientation(familyInstance=sortByKey.sorted_list)
ZAxis = Vector.ZAxis()
cross = Vector.Cross(vector=facingOrientation, cross=ZAxis)
byOriginVectors = CoordinateSystem.ByOriginVectors(origin=location, xAxis=cross, yAxis=facingOrientation, zAxis=ZAxis)

# group: Move and Rotate Shelves to Origin for Ease of Calculation
identity = CoordinateSystem.Identity()
transform = Geometry.Transform(geometry=sortByKey_2.sorted_list, fromCoordinateSystem=byOriginVectors, contextCoordinateSystem=identity)

# group: Get Indexes
# note: Use 1-based indexing to match shelf parameters
count = List.Count(list=transform@L2)
code_block_6 = CodeBlock(c=count) { 1..c; }

# group: Get Min and Max Point Coordinates for Shelf Bounding Boxes
byGeometry = BoundingBox.ByGeometry(geom=transform@@L1)
minPoint = BoundingBox.MinPoint(boundingBox=byGeometry)
X = Point.X(point=minPoint)
code_block_7 = CodeBlock { 2; }
round = Math.Round(number=X, digits=code_block_7)
Y = Point.Y(point=minPoint)
round_2 = Math.Round(number=Y, digits=code_block_7)
Z_2 = Point.Z(point=minPoint)
round_3 = Math.Round(number=Z_2, digits=code_block_7)
maxPoint = BoundingBox.MaxPoint(boundingBox=byGeometry)
X_2 = Point.X(point=maxPoint)
round_4 = Math.Round(number=X_2, digits=code_block_7)
Y_2 = Point.Y(point=maxPoint)
round_5 = Math.Round(number=Y_2, digits=code_block_7)
Z_3 = Point.Z(point=maxPoint)
round_6 = Math.Round(number=Z_3, digits=code_block_7)

# group: Prepare Data
list_create_2 = List.Create(item0=code_block_6, item1=round, item2=round_2, item3=round_3, item4=round_4, item5=round_5, item6=round_6, item7=sortByKey_3.sorted_list)
transpose = List.Transpose(lists=list_create_2)
transpose_2 = List.Transpose(lists=transpose@L3)

# group: Force DateTime to Rerun Each Time new Geometry is Calculated
code_block_8 = CodeBlock(x=list_create_2) { [DSCore.DateTime.Now,x][0]; }
code_block_9 = CodeBlock { "yyMMddTHHmmss"; }
format = DateTime.Format(dateTime=code_block_8, format=code_block_9)

# group: Environment Variables (Adapted from Clockwork)
python_script_2 = Python()  # unwired: IN[0]
# ---------- python_script_2.python (13 lines) ----------
#Adapted from Clockwork 

import clr
from System import Environment
from System.Reflection import Assembly
from System.Diagnostics import Process

dynamoCore = Assembly.Load("DynamoCore")
version_long = dynamoCore.GetName().Version.ToString()
version_short = version_long[:5]
proc = Process.GetCurrentProcess().ProcessName

OUT = Environment.UserName, Environment.MachineName, version_short, version_long, proc
# ----------------------------------------

code_block_10 = CodeBlock(mark=sortByKey.sorted_keys) { mark; DSCore.List.Count(mark); }

# group: Scenario and Dynamo Graph Name
scenario_description = StringInput("Seven Shelves as Now")
script_name = StringInput("FurtherLibrary_1_CreateBookcaseScenario")

# group: Work out Combinations for Flexible Shelves
flatten_2 = List.Flatten(list=sortByKey_3.sorted_list)
eq = flatten_2 == flexible_shelf_name
countTrue = List.CountTrue(list=eq)
code_block_11 = CodeBlock(n=countTrue) { Math.Pow(2,n); }

# group: Dictionary Keys
code_block_12 = CodeBlock()
# ---------- code_block_12.designscript (15 lines) ----------
[
"id",
"csOriginX",
"csOriginY",
"csOriginZ",
"csXAxisX",
"csXAxisY",
"csYAxisX",
"csYAxisY",
"Revit Family Name",
"Revit Type Name",
"heightAboveBookcase",
"totalBookcaseHeight",
"shelves"
];
# ----------------------------------------

# group: Miscellany: Display CoordinateSystem
coordinateSystemDisplay = Miscellany.Geometry.Abstract.CoordinateSystemDisplay(coordinateSystem=byOriginVectors)

# group: CS Origin Points
X_3 = Point.X(point=coordinateSystemDisplay.Origin)
Y_3 = Point.Y(point=coordinateSystemDisplay.Origin)
Z_4 = Point.Z(point=coordinateSystemDisplay.Origin)

# group: X Axis Vector Components
X_4 = Vector.X(vector=coordinateSystemDisplay.XAxis)
Y_4 = Vector.Y(vector=coordinateSystemDisplay.XAxis)

# group: Y Axis Vector Components
X_5 = Vector.X(vector=coordinateSystemDisplay.YAxis)
Y_5 = Vector.Y(vector=coordinateSystemDisplay.YAxis)

# group: Revit Family and Type Names
elementType = Element.ElementType(element=sortByKey.sorted_list)
family = FamilyType.Family(familyType=elementType)
name = Family.Name(family=family)
name_2 = Element.Name(element=elementType)

# group: Get Height above Bookcase
string_4 = StringInput("HeightAboveTopOfBookcase")
getParameterValueByName_2 = Element.GetParameterValueByName(element=sortByKey.sorted_list, parameterName=string_4)

# group: Get Overall Height of Bookcase including Allowance Above
boundingBox = Element.BoundingBox(element=sortByKey.sorted_list)
maxPoint_2 = BoundingBox.MaxPoint(boundingBox=boundingBox)
Z_5 = Point.Z(point=maxPoint_2)
minPoint_2 = BoundingBox.MinPoint(boundingBox=boundingBox)
Z_6 = Point.Z(point=minPoint_2)
code_block_13 = CodeBlock(top=Z_5, bottom=Z_6, height=getParameterValueByName_2) { top-bottom+height; }

# group: Dictionary Keys
code_block_14 = CodeBlock()
# ---------- code_block_14.designscript (11 lines) ----------
[
"id",
"minX",
"minY",
"minZ",
"maxX",
"maxY",
"maxZ",
"shelfType",
"shelfParam"
];
# ----------------------------------------

# group: Get Parameters Starting with S-
parameters = Element.Parameters(element=sortByKey.sorted_list)
name_3 = Parameter.Name(parameter=parameters)
string_5 = StringInput("S-")
startsWith = String.StartsWith(str=name_3, searchFor=string_5)
filterByBoolMask = List.FilterByBoolMask(list=parameters, mask=startsWith)

# group: Sort Parameters from Bottom to Top
string_from_object = FromObject(obj=filterByBoolMask.in)
string_6 = StringInput(" : ")
split_2 = String.Split(str=string_from_object, separater0=string_6)
lastItem = List.LastItem(list=split_2@@L2)
firstItem = List.FirstItem(list=split_2@@L2)
string_7 = StringInput("-")
split_3 = String.Split(str=firstItem, separater0=string_7)
lastItem_2 = List.LastItem(list=split_3@@L2)
toNumber_2 = String.ToNumber(str=lastItem_2)
sortByKey_4 = List.SortByKey(list=lastItem@L2, keys=toNumber_2@L2)

# group: Filter out None Shelf Parameters
contains = String.Contains(str=sortByKey_4.sorted_list, searchFor=none_shelf_name)
filterByBoolMask_2 = List.FilterByBoolMask(list=sortByKey_4.sorted_list, mask=contains)
filterByBoolMask_3 = List.FilterByBoolMask(list=sortByKey_4.sorted_keys, mask=contains)

# group: Match Flexible Shelves to Parameter
python_script_3 = Python(IN[0]=transpose_2, IN[1]=filterByBoolMask_2.out, IN[2]=filterByBoolMask_3.out, IN[3]=none_shelf_name)
# ---------- python_script_3.python (17 lines) ----------
bookcases = IN[0]
parameters = IN[1]
parameterKeys = IN[2]
nameNone = IN[3]

out = []

for bookcase, params, paramKeys in zip(bookcases, parameters, parameterKeys):
	out.append([])
	for shelf, param, paramKey in zip(bookcase, params, paramKeys):
		if param.startswith(shelf[7]):
			shelf.append('S-'+str(paramKey))
		else:
			shelf.append('Error') # There is a mismatch between parameter and subcategory
		out[-1].append(shelf)

OUT = out
# ----------------------------------------

# group: Create Dictionary for Shelves
byKeysValues = DesignScript.Builtin.Dictionary.ByKeysValues(keys=code_block_14, values=python_script_3@@L2)
code_block_15 = CodeBlock { "id"; }
valueAtKey = DesignScript.Builtin.Dictionary.ValueAtKey(dictionary=byKeysValues, key=code_block_15)
string_from_object_2 = FromObject(obj=valueAtKey)
byKeysValues_2 = DesignScript.Builtin.Dictionary.ByKeysValues(keys=string_from_object_2@L2, values=byKeysValues@L2)

# group: Prepare Data
list_create_3 = List.Create(item0=code_block_10.mark, item1=X_3, item2=Y_3, item3=Z_4, item4=X_4, item5=Y_4, item6=X_5, item7=Y_5, item8=name, item9=name_2, item10=getParameterValueByName_2, item11=code_block_13, item12=byKeysValues_2)
transpose_3 = List.Transpose(lists=list_create_3)

# group: Create List of Bookcase Dictionaries
byKeysValues_3 = DesignScript.Builtin.Dictionary.ByKeysValues(keys=code_block_12, values=transpose_3@L2)

# group: Bookcase id as Key
code_block_16 = CodeBlock { "id"; }
valueAtKey_2 = DesignScript.Builtin.Dictionary.ValueAtKey(dictionary=byKeysValues_3, key=code_block_16)
string_from_object_3 = FromObject(obj=valueAtKey_2)

# group: JsonData
byDictionary = JsonData.Elements.JsonObject.ByDictionary(dictionary=byKeysValues_3)

# group: Create Bookcase Dictionary
byKeysValues_4 = DesignScript.Builtin.Dictionary.ByKeysValues(keys=string_from_object_3, values=byDictionary)

# group: JSON Output Directory Path
directory_path = Directory("C:\Users\Thomas.corrie\Box Sync\Library\Json\BookcaseScenarios")

# group: Concatenate Name and FilePath for Json File
code_block_17 = CodeBlock { " "; ""; }
replace = String.Replace(str=scenario_description, searchFor=code_block_17.out0, replaceWith=code_block_17.out1)
code_block_18 = CodeBlock(t=format, name=replace) { t+"_"+name; }
code_block_19 = CodeBlock(p=directory_path, name=code_block_18) { p+"\\"+name+".json"; }

# group: Build Scenario Data
list_create_4 = List.Create(item0=code_block_3, item1=code_block_8, item2=python_script_2, item3=code_block_10.out1, item4=scenario_description, item5=script_name, item6=code_block_11, item7=code_block_18)
flatten_3 = List.Flatten(list=list_create_4)

# group: Create Scenario Dictionary
byKeysValues_5 = DesignScript.Builtin.Dictionary.ByKeysValues(keys=code_block_2, values=flatten_3)

code_block_20 = CodeBlock(d=byKeysValues_5, x=byKeysValues_4) { [d,x]; }

# group: Create Overall Dictionary
byKeysValues_6 = DesignScript.Builtin.Dictionary.ByKeysValues(keys=code_block, values=code_block_20)

# group: JsonData
byDictionary_2 = JsonData.Elements.JsonObject.ByDictionary(dictionary=byKeysValues_6)
toJsonFile = JsonData.Utilities.Write.ToJsonFile(jsonObjects=byDictionary_2, filepath=code_block_19)
