# Dynamo graph FurtherLibrary_2_ImportAndPack.dyn (Dynamo 2.4.0.6186)
# packages: JsonData 2.0.2, Miscellany 1.2.0

# group: FurtherLibrary_2_ImportAndPack.dyn
# note: Written by Thomas Corrie
# for BiLT Europe Presentation
# "Further Optimizing an Architect's Bookshelf"
# 12th October 2019

# group: Shelf Type Names
flexible_shelf = CodeBlock { "Shelf-Flexible"; }
empty_shelf = CodeBlock { "Shelf-Empty"; }

# group: Select JSON
file_path = Filename("Json\Library\librarything_thomascorrie_cleaned.json")

# group: JsonData: Parse JSON to dictionary
fromJsonFile = JsonData.Utilities.Read.FromJsonFile(filepath=file_path)
toDictionary = JsonData.Elements.JsonObject.ToDictionary(jsonObject=fromJsonFile)

# group: Number of Books to Process (for testing)
integer_slider = IntegerSlider(1000, range=0..1000 step 1)

takeItems = List.TakeItems(list=toDictionary, amount=integer_slider)

# group: Select Keys
string = StringInput("ddc")
string_2 = StringInput("code")

# group: Get Classification values
valueAtKey = DesignScript.Builtin.Dictionary.ValueAtKey(dictionary=takeItems, key=string)
valueAtKey_2 = DesignScript.Builtin.Dictionary.ValueAtKey(dictionary=valueAtKey, key=string_2)
firstItem = List.FirstItem(list=valueAtKey_2@L2)

# group: Number of Books with no Classification
isNull = Object.IsNull(obj=firstItem)
countTrue = List.CountTrue(list=isNull)
isNull_2 = Object.IsNull(obj=valueAtKey)
countTrue_2 = List.CountTrue(list=isNull_2)

# group: Establish Key
string_from_object = FromObject(obj=firstItem)
code_block = CodeBlock { 0; 1; }
substring = String.Substring(str=string_from_object, startIndex=code_block.out0, length=code_block.out1)

# group: Group By Key and Sort
groupByKey = List.GroupByKey(list=takeItems, keys=substring)
watch = Watch(groupByKey.unique_keys)
sortByKey = List.SortByKey(list=groupByKey.groups, keys=watch)
watch_2 = Watch(sortByKey.sorted_keys)

# group: Scenario JSON File Location
file_path_2 = Filename("..\Json\3_PackingJob\job.json")

# group: JsonData
fromJsonFile_2 = JsonData.Utilities.Read.FromJsonFile(filepath=file_path_2)
toDictionary_2 = JsonData.Elements.JsonObject.ToDictionary(jsonObject=fromJsonFile_2)

# group: Deconstruct Dictionaries
code_block_2 = CodeBlock { "scenario"; }
valueAtKey_3 = DesignScript.Builtin.Dictionary.ValueAtKey(dictionary=toDictionary_2, key=code_block_2)
code_block_3 = CodeBlock { "bookcases"; }
valueAtKey_4 = DesignScript.Builtin.Dictionary.ValueAtKey(dictionary=toDictionary_2, key=code_block_3)
values = DesignScript.Builtin.Dictionary.Values(dictionary=valueAtKey_4)
code_block_4 = CodeBlock { "variables"; }
valueAtKey_5 = DesignScript.Builtin.Dictionary.ValueAtKey(dictionary=toDictionary_2, key=code_block_4)

# group: Get heightAboveBookcase
code_block_5 = CodeBlock { "heightAboveBookcase"; }
valueAtKey_6 = DesignScript.Builtin.Dictionary.ValueAtKey(dictionary=values, key=code_block_5)

# group: Sort Shelves
code_block_6 = CodeBlock { "id"; }
code_block_7 = CodeBlock { "shelves"; }
valueAtKey_7 = DesignScript.Builtin.Dictionary.ValueAtKey(dictionary=values, key=code_block_7)
values_2 = DesignScript.Builtin.Dictionary.Values(dictionary=valueAtKey_7)
valueAtKey_8 = DesignScript.Builtin.Dictionary.ValueAtKey(dictionary=values_2, key=code_block_6)
sortByKey_2 = List.SortByKey(list=values_2@L2, keys=valueAtKey_8@L2)

# group: Get Shelf Data
valueAtKey_9 = DesignScript.Builtin.Dictionary.ValueAtKey(dictionary=values, key=code_block_6)
code_block_8 = CodeBlock { "shelfType"; }
valueAtKey_10 = DesignScript.Builtin.Dictionary.ValueAtKey(dictionary=sortByKey_2.sorted_list, key=code_block_8)
code_block_9 = CodeBlock { "use"; }
valueAtKey_11 = DesignScript.Builtin.Dictionary.ValueAtKey(dictionary=sortByKey_2.sorted_list, key=code_block_9)
code_block_10 = CodeBlock()
# ---------- code_block_10.designscript (8 lines) ----------
[
"minX",
"minY",
"minZ",
"maxX",
"maxY",
"maxZ"
];
# ----------------------------------------
valueAtKey_12 = DesignScript.Builtin.Dictionary.ValueAtKey(dictionary=sortByKey_2.sorted_list, key=code_block_10, lacing=CrossProduct)
code_block_11 = CodeBlock { "shelfParam"; }
valueAtKey_13 = DesignScript.Builtin.Dictionary.ValueAtKey(dictionary=sortByKey_2.sorted_list, key=code_block_11)

# group: Filter Flexible Shelves
filterByBoolMask = List.FilterByBoolMask(list=valueAtKey_10, mask=valueAtKey_11)
transpose = List.Transpose(lists=valueAtKey_12)
code_block_12 = CodeBlock(x=transpose) { x[0]; x[1]; x[2]; x[3]; x[4]; x[5]; }
filterByBoolMask_2 = List.FilterByBoolMask(list=code_block_12.out0, mask=valueAtKey_11)
filterByBoolMask_3 = List.FilterByBoolMask(list=code_block_12.out1, mask=valueAtKey_11)
filterByBoolMask_4 = List.FilterByBoolMask(list=code_block_12.out2, mask=valueAtKey_11)
filterByBoolMask_5 = List.FilterByBoolMask(list=code_block_12.out3, mask=valueAtKey_11)
filterByBoolMask_6 = List.FilterByBoolMask(list=code_block_12.out4, mask=valueAtKey_11)
filterByBoolMask_7 = List.FilterByBoolMask(list=code_block_12.out5, mask=valueAtKey_11)

# group: Get priority
code_block_13 = CodeBlock { "priority"; }
valueAtKey_14 = DesignScript.Builtin.Dictionary.ValueAtKey(dictionary=values, key=code_block_13)

# group: Get totalBookcaseHeight
code_block_14 = CodeBlock { "totalBookcaseHeight"; }
valueAtKey_15 = DesignScript.Builtin.Dictionary.ValueAtKey(dictionary=values, key=code_block_14)

# group: Calculate Priority Heights
count = List.Count(list=valueAtKey_14@L2)
code_block_15 = CodeBlock(n=count) { 0..1..#(n+1); }
code_block_16 = CodeBlock { 1; }
dropItems = List.DropItems(list=code_block_15@L2, amount=code_block_16)
code_block_17 = CodeBlock(p=dropItems, height=valueAtKey_15) { p*height; }

# group: Calculate Shelf bins
py = Python(IN[0]=valueAtKey_6, IN[1]=valueAtKey_9, IN[2]=filterByBoolMask.in, IN[3]=empty_shelf, IN[4]=filterByBoolMask_2.in, IN[5]=filterByBoolMask_3.in, IN[6]=filterByBoolMask_4.in, IN[7]=filterByBoolMask_5.in, IN[8]=filterByBoolMask_6.in, IN[9]=filterByBoolMask_7.in, IN[10]=code_block_17, IN[11]=valueAtKey_14)  # "Bins.py"
# ---------- py.python (54 lines) ----------
# Enable Python support and load DesignScript library
import clr
clr.AddReference('ProtoGeometry')
from Autodesk.DesignScript.Geometry import *

# IN
topHeights = IN[0]
marks = IN[1] # the Mark values for the shelf instances
shelfTypes = IN[2] # type of shelves
empty = IN[3] # name for empty shelves
minXs = IN[4] # x value of minimum point of shelf bounding box
minYs = IN[5] # y value of minimum point of shelf bounding box
minZs = IN[6] # z value of minimum point of shelf bounding box
maxXs = IN[7] # x value of maximum point of shelf bounding box
maxYs = IN[8] # y value of maximum point of shelf bounding box
maxZs = IN[9] # z value of maximum point of shelf bounding box
prHeights = IN[10] # heights for priority changes
prValues = IN[11] # values for priorities


# Structure for assembling Dictionary after output 
values = []

for mark, shelfType, minX, minY, minZ, maxX, maxY, maxZ, topHeight, prHeight, prValue in zip(marks, shelfTypes, minXs, minYs, minZs, maxXs, maxYs, maxZs, topHeights, prHeights, prValues): # loop through each bookcase
	for i in range(len(minX)): # loop through each shelf in bookcase
		shelf = str(i+1) # Shelf number within bookcase
		# is the bin to be calculated?
		if shelfType[i] == empty:
			continue # Do not caluclate bin for empty shelves
		# Calculate absolute dimensions for the shelf bin
		x = maxX[i] - minX[i] # x - front dimension of the shelf
		y = maxY[i] - minY[i] # y - depth of the shelf
		# For height we need to look at the underside of the shelf above
		if i < len(minX) - 1: # normal shelves
			#for v in bookcase[i+1]:
			#	zas.append(round(v.Z,1))
			z = minZ[i+1] - maxZ[i] # z - height of space for shelf
		else: # On top of bookcase so no shelf above
			z = topHeight # z - height of space for shelf
			if topHeight == 0 or shelfType[i].startswith(empty):
				continue
		# set container priority
		priority = 0
		for height, value in zip(prHeight, prValue):
			if maxZ[i] < height:
				priority = value
				break
		# create values for dictionary
		id = str(mark) + "-" + shelf
		numId = (mark * 1000) + (i + 1)
		values.append([id,numId,mark,shelf,x,y,z,minX[i],minY[i],maxZ[i],priority])

# OUT
OUT = values
# ----------------------------------------

# group: Assemble Dictionary for Each Bin
code_block_dictionary_structure = CodeBlock()
# ---------- code_block_dictionary_structure.designscript (13 lines) ----------
[
"id",
"numId",
"bookcase",
"shelf",
"x",
"y",
"z",
"xpos",
"ypos",
"zpos",
"priority"
];
# ----------------------------------------
byKeysValues = DesignScript.Builtin.Dictionary.ByKeysValues(keys=code_block_dictionary_structure, values=py@L2)

# group: Sort Containers by Priority
string_3 = StringInput("priority")
valueAtKey_16 = DesignScript.Builtin.Dictionary.ValueAtKey(dictionary=byKeysValues, key=string_3)
sortByKey_3 = List.SortByKey(list=byKeysValues, keys=valueAtKey_16)

code_block_18 = CodeBlock(dict=sortByKey_3.sorted_list) { dict; }

# group: Bin Sizes
string_4 = StringInput("numId")
valueAtKey_17 = DesignScript.Builtin.Dictionary.ValueAtKey(dictionary=code_block_18, key=string_4)
string_5 = StringInput("x")
valueAtKey_18 = DesignScript.Builtin.Dictionary.ValueAtKey(dictionary=code_block_18, key=string_5)
string_6 = StringInput("y")
valueAtKey_19 = DesignScript.Builtin.Dictionary.ValueAtKey(dictionary=code_block_18, key=string_6)
string_7 = StringInput("z")
valueAtKey_20 = DesignScript.Builtin.Dictionary.ValueAtKey(dictionary=code_block_18, key=string_7)
string_8 = StringInput("priority")
valueAtKey_21 = DesignScript.Builtin.Dictionary.ValueAtKey(dictionary=code_block_18, key=string_8)

# group: Miscellany Container
container = Miscellany.ContainerPacking.Entities.Container.Container(id=valueAtKey_17, length=valueAtKey_18, width=valueAtKey_19, height=valueAtKey_20, priority=valueAtKey_21)

# group: Item Sizes
string_9 = StringInput("books_id")
valueAtKey_22 = DesignScript.Builtin.Dictionary.ValueAtKey(dictionary=sortByKey.sorted_list, key=string_9)
toNumber = String.ToNumber(str=valueAtKey_22)
string_10 = StringInput("dimX")
valueAtKey_23 = DesignScript.Builtin.Dictionary.ValueAtKey(dictionary=sortByKey.sorted_list, key=string_10)
string_11 = StringInput("dimY")
valueAtKey_24 = DesignScript.Builtin.Dictionary.ValueAtKey(dictionary=sortByKey.sorted_list, key=string_11)
string_12 = StringInput("dimZ")
valueAtKey_25 = DesignScript.Builtin.Dictionary.ValueAtKey(dictionary=sortByKey.sorted_list, key=string_12)

# group: Packing Group
count_2 = List.Count(list=sortByKey.sorted_list)
code_block_19 = CodeBlock(c=count_2) { 0..c-1; }

# group: Remap Item Priority Range to Container Priority Range
minimumItem = List.MinimumItem(list=code_block_19)
maximumItem = List.MaximumItem(list=code_block_19)
uniqueItems = List.UniqueItems(list=valueAtKey_21)
minimumItem_2 = List.MinimumItem(list=uniqueItems)
maximumItem_2 = List.MaximumItem(list=uniqueItems)
mapTo = Math.MapTo(rangeMin=minimumItem, rangeMax=maximumItem, inputValue=code_block_19, targetRangeMin=minimumItem_2, targetRangeMax=maximumItem_2)
round = Math.Round(number=mapTo)

# group: Miscellany Item
item = Miscellany.ContainerPacking.Entities.Item.Item(id=toNumber, dim1=valueAtKey_23, dim2=valueAtKey_24, dim3=valueAtKey_25, group=code_block_19, priority=round)

flatten = List.Flatten(list=item)

# group: Get Variables
code_block_20 = CodeBlock()
# ---------- code_block_20.designscript (10 lines) ----------
[
"minimumItems",
"maxCantilever",
"containerStrategy",
"containerOrientation",
"infillVolumePriority",
"infillMaxHeight",
"bookAlignment",
"scoringWeights"
];
# ----------------------------------------
valueAtKey_26 = DesignScript.Builtin.Dictionary.ValueAtKey(dictionary=valueAtKey_5, key=code_block_20)
code_block_21 = CodeBlock(x=valueAtKey_26) { x[0]; x[1]; x[2]; x[3]; x[4]; x[5]; x[6]; x[7]; }

code_block_22 = CodeBlock(x=code_block_21.out7) { x[0]; x[1]; x[2]; x[3]; }

# group: Miscellany Scoring Configuration
score = Miscellany.ContainerPacking.Score.Score(itemOrientation=code_block_22.out0, itemPosition=code_block_22.out1, itemPriority=code_block_22.out2, itemGrouping=code_block_22.out3)

# group: Miscellany Algorithm
code_block_23 = CodeBlock { 1; }
placeBooksAndInfill = Miscellany.ContainerPacking.Algorithms.PlaceBooksAndInfill(alignment=code_block_21.out6, maximumCantilever=code_block_21.out1, maximumGap=code_block_23, infillContainerOrientation=code_block_21.out3, infillVolumePriority=code_block_21.out4, infillMaxHeight=code_block_21.out5, scoringConfiguration=score)

# group: Miscellany Pack
packContainers = Miscellany.ContainerPacking.PackingService.PackContainers(containers=container, itemsToPack=flatten, algorithm=placeBooksAndInfill, containerStrategy=code_block_21.out2, minimumItems=code_block_21.out0)

# group: Number of Books Packed
count_3 = List.Count(list=packContainers.packedItems@L2)
sum = Math.Sum(values=count_3)
watch_3 = Watch(sum)

# group: Logging details (Adapted from Clockwork)
python_script = Python()  # unwired: IN[0]
# ---------- python_script.python (13 lines) ----------
#Adapted from Clockwork 

import clr
from System import Environment
from System.Reflection import Assembly
from System.Diagnostics import Process

dynamoCore = Assembly.Load("DynamoCore")
version_long = dynamoCore.GetName().Version.ToString()
version_short = version_long[:5]
proc = Process.GetCurrentProcess().ProcessName

OUT = Environment.UserName, Environment.MachineName, version_short, version_long, proc
# ----------------------------------------
script_name = StringInput("FurtherLibrary_2_ImportAndPack")

# group: Scenario Details
code_block_24 = CodeBlock { ["description","scenarioName"]; }
valueAtKey_27 = DesignScript.Builtin.Dictionary.ValueAtKey(dictionary=valueAtKey_3, key=code_block_24)

# group: DateTime and Filename
code_block_25 = CodeBlock(x=watch_3) { [DSCore.DateTime.Now,x][0]; }
code_block_26 = CodeBlock { "yyMMddTHHmmss"; }
format = DateTime.Format(dateTime=code_block_25, format=code_block_26)
code_block_27 = CodeBlock(s=valueAtKey_27, t=format) { s[1]+"_"+t; }

# group: Number of Books Not Packed
count_4 = List.Count(list=packContainers.unpackedItems@L2)
sum_2 = Math.Sum(values=count_4)
watch_4 = Watch(sum_2)

# group: Total Number of Books To Be Packed
count_5 = List.Count(list=flatten)
sum_3 = Math.Sum(values=count_5)
watch_5 = Watch(sum_3)

# group: Counts
discrepancy_between_counts = CodeBlock(t=watch_5, p=watch_3, n=watch_4) { t-(p+n); }
code_block_28 = CodeBlock { 0; }
not_packed = CodeBlock(t=watch_5, p=watch_3) { t-p; }
cycle = List.Cycle(list=code_block_28, amount=not_packed)
packed_items = CodeBlock(p=watch_3, t=watch_5) { p/t*100; }

# group: Number of Containers
count_6 = List.Count(list=container@L2)
sum_4 = Math.Sum(values=count_6)
watch_6 = Watch(sum_4)

# group: Integer Conversion
convert_to_integer = CodeBlock(numBooksPacked=watch_3, numBooksNotPacked=watch_4, numDiscrepancy=discrepancy_between_counts, numBooksTotal=watch_5, numContainers=watch_6) { numBooksPacked:int[]; numBooksNotPacked:int[]; numDiscrepancy:int[]; numBooksTotal:int[]; numContainers:int[]; }

# group: Miscellany
score_2 = Miscellany.ContainerPacking.Entities.Item.Score(item=packContainers.packedItems)
totalPackTimeInMilliseconds = Miscellany.ContainerPacking.PackingStatistics.TotalPackTimeInMilliseconds(packingStatistics=packContainers.packingStatistics)
ID = Miscellany.ContainerPacking.Entities.Item.ID(item=packContainers.packedItems)
containerID = Miscellany.ContainerPacking.Entities.Item.ContainerID(item=packContainers.packedItems)
packDimX = Miscellany.ContainerPacking.Entities.Item.PackDimX(item=packContainers.packedItems)
packDimY = Miscellany.ContainerPacking.Entities.Item.PackDimY(item=packContainers.packedItems)
packDimZ = Miscellany.ContainerPacking.Entities.Item.PackDimZ(item=packContainers.packedItems)
coordX = Miscellany.ContainerPacking.Entities.Item.CoordX(item=packContainers.packedItems)
coordY = Miscellany.ContainerPacking.Entities.Item.CoordY(item=packContainers.packedItems)
coordZ = Miscellany.ContainerPacking.Entities.Item.CoordZ(item=packContainers.packedItems)
sequence = Miscellany.ContainerPacking.Entities.Item.Sequence(item=packContainers.packedItems)
group = Miscellany.ContainerPacking.Entities.Item.Group(item=packContainers.packedItems)
dim1 = Miscellany.ContainerPacking.Entities.Item.Dim1(item=packContainers.packedItems)
dim2 = Miscellany.ContainerPacking.Entities.Item.Dim2(item=packContainers.packedItems)
dim3 = Miscellany.ContainerPacking.Entities.Item.Dim3(item=packContainers.packedItems)

# group: Average Book Score (Including 0 for Non-Packed Books)
list_create = List.Create(item0=score_2, item1=cycle)
flatten_2 = List.Flatten(list=list_create)
average = Math.Average(numbers=flatten_2)

# group: Average Placed Book Score
flatten_3 = List.Flatten(list=score_2)
average_2 = Math.Average(numbers=flatten_3)

# group: Time of Pack in Seconds
code_block_29 = CodeBlock(t=totalPackTimeInMilliseconds) { t/1000; }
watch_7 = Watch(code_block_29)

# group: Result Dictionary
code_block_30 = CodeBlock()
# ---------- code_block_30.designscript (20 lines) ----------
[
"datetime",
"username",
"computer",
"dynamoShort",
"dynamoLong",
"platform",
"description",
"scenarioName",
"packName",
"dynamoFilename",
"numBooksPacked",
"numBooksTotal",
"meanScore",
"meanScorePlaced",
"numContainers",
"timePack",
"numDiscrepancy",
"numBooksNotPacked"
];
# ----------------------------------------
list_create_2 = List.Create(item0=format, item1=python_script, item2=valueAtKey_27, item3=code_block_27, item4=script_name, item5=convert_to_integer.out0, item6=convert_to_integer.out3, item7=average, item8=average_2, item9=convert_to_integer.out4, item10=watch_7, item11=convert_to_integer.out2, item12=convert_to_integer.out1)
flatten_4 = List.Flatten(list=list_create_2)
byKeysValues_2 = DesignScript.Builtin.Dictionary.ByKeysValues(keys=code_block_30, values=flatten_4)

# group: Dictionary for All Bins
string_13 = StringInput("numId")
valueAtKey_28 = DesignScript.Builtin.Dictionary.ValueAtKey(dictionary=sortByKey_3.sorted_list, key=string_13)
string_from_object_2 = FromObject(obj=valueAtKey_28)
byKeysValues_3 = DesignScript.Builtin.Dictionary.ByKeysValues(keys=string_from_object_2, values=sortByKey_3.sorted_list)

# group: Create List of Dictionaries for Packed Books
code_block_31 = CodeBlock()
# ---------- code_block_31.designscript (16 lines) ----------
[
"id",
"containerId",
"score",
"packDimX",
"packDimY",
"packDimZ",
"coordX",
"coordY",
"coordZ",
"sequence",
"group",
"dimX",
"dimY",
"dimZ"
];
# ----------------------------------------
list_create_3 = List.Create(item0=ID, item1=containerID, item2=score_2, item3=packDimX, item4=packDimY, item5=packDimZ, item6=coordX, item7=coordY, item8=coordZ, item9=sequence, item10=group, item11=dim1, item12=dim2, item13=dim3)
transpose_2 = List.Transpose(lists=list_create_3@L4)
transpose_3 = List.Transpose(lists=transpose_2@L3)
# note: Create dictionaries of books, nested by shelf
byKeysValues_4 = DesignScript.Builtin.Dictionary.ByKeysValues(keys=code_block_31, values=transpose_3@@L2)

# group: Remove Empty Lists of Books
boolean = BoolSelector(false)
clean = List.Clean(list=byKeysValues_4, preserveIndices=boolean)

# group: Create Single Dictionary for Packed Books
flatten_5 = List.Flatten(list=clean)
string_14 = StringInput("id")
valueAtKey_29 = DesignScript.Builtin.Dictionary.ValueAtKey(dictionary=flatten_5, key=string_14)
string_from_object_3 = FromObject(obj=valueAtKey_29)
byKeysValues_5 = DesignScript.Builtin.Dictionary.ByKeysValues(keys=string_from_object_3, values=flatten_5)

# group: Miscellany
ID_2 = Miscellany.ContainerPacking.Entities.Item.ID(item=packContainers.unpackedItems)
dim1_2 = Miscellany.ContainerPacking.Entities.Item.Dim1(item=packContainers.unpackedItems)
dim2_2 = Miscellany.ContainerPacking.Entities.Item.Dim2(item=packContainers.unpackedItems)
dim3_2 = Miscellany.ContainerPacking.Entities.Item.Dim3(item=packContainers.unpackedItems)
group_2 = Miscellany.ContainerPacking.Entities.Item.Group(item=packContainers.unpackedItems)
score_3 = Miscellany.ContainerPacking.Entities.Item.Score(item=packContainers.unpackedItems)

# group: Create List of Dictionaries for Packed Books
code_block_32 = CodeBlock()
# ---------- code_block_32.designscript (8 lines) ----------
[
"id",
"dimX",
"dimY",
"dimZ",
"group",
"score"
];
# ----------------------------------------
list_create_4 = List.Create(item0=ID_2, item1=dim1_2, item2=dim2_2, item3=dim3_2, item4=group_2, item5=score_3)
transpose_4 = List.Transpose(lists=list_create_4@L3)
# note: Create dictionaries of unpacked books
byKeysValues_6 = DesignScript.Builtin.Dictionary.ByKeysValues(keys=code_block_32, values=transpose_4@@L2)

# group: Create Single Dictionary for Unpacked Books
flatten_6 = List.Flatten(list=byKeysValues_6)
string_15 = StringInput("id")
valueAtKey_30 = DesignScript.Builtin.Dictionary.ValueAtKey(dictionary=flatten_6, key=string_15)
string_from_object_4 = FromObject(obj=valueAtKey_30)
byKeysValues_7 = DesignScript.Builtin.Dictionary.ByKeysValues(keys=string_from_object_4, values=flatten_6)

# group: JsonData
byDictionary = JsonData.Elements.JsonObject.ByDictionary(dictionary=byKeysValues_3)
byDictionary_2 = JsonData.Elements.JsonObject.ByDictionary(dictionary=byKeysValues_5)
byDictionary_3 = JsonData.Elements.JsonObject.ByDictionary(dictionary=byKeysValues_7)

byDictionary_4 = JsonData.Elements.JsonObject.ByDictionary(dictionary=valueAtKey_5)

# group: Directory Path for Json Output
directory_path = Directory("C:\Users\Thomas.corrie\Box Sync\Library\libraryproject\Json\4_PackingResults")

# group: Create Dictionary
code_block_33 = CodeBlock()
# ---------- code_block_33.designscript (9 lines) ----------
[
"scenario",
"result",
"bookcases",
"containers",
"books",
"unpacked",
"variables"
];
# ----------------------------------------
list_create_5 = List.Create(item0=valueAtKey_3, item1=byKeysValues_2, item2=valueAtKey_4, item3=byDictionary, item4=byDictionary_2, item5=byDictionary_3, item6=byDictionary_4)
byKeysValues_8 = DesignScript.Builtin.Dictionary.ByKeysValues(keys=code_block_33, values=list_create_5)
code_block_34 = CodeBlock(p=directory_path, name=code_block_27) { p+"\\"+name+".json"; }

# group: JsonData
byDictionary_5 = JsonData.Elements.JsonObject.ByDictionary(dictionary=byKeysValues_8)
toJsonFile = JsonData.Utilities.Write.ToJsonFile(jsonObjects=byDictionary_5, filepath=code_block_34)

watch_8 = Watch(code_block_21.out7)
