# Dynamo graph FurtherLibrary_3_Visualize.dyn (Dynamo 2.0.3.8810)

# group: FurtherLibrary_3_Visualize.dyn
# note: Written by Thomas Corrie
# for BiLT Europe Presentation
# "Further Optimizing an Architect's Bookshelf"
# 12th October 2019

# group: Packing Results JSON File Location
file_path = Filename("Json\PackingResults\191006T113210_SevenShelvesasNow_191006T140606.json")

# group: JsonData
fromJsonFile = JsonData.Utilities.Read.FromJsonFile(filepath=file_path)
toDictionary = JsonData.Elements.JsonObject.ToDictionary(jsonObject=fromJsonFile)

# group: Get Container Data
code_block = CodeBlock { "containers"; }
valueAtKey = DesignScript.Builtin.Dictionary.ValueAtKey(dictionary=toDictionary, key=code_block)
values = DesignScript.Builtin.Dictionary.Values(dictionary=valueAtKey)

# group: Bin Cuboids at Origin
string = StringInput("x")
valueAtKey_2 = DesignScript.Builtin.Dictionary.ValueAtKey(dictionary=values, key=string)
string_2 = StringInput("y")
valueAtKey_3 = DesignScript.Builtin.Dictionary.ValueAtKey(dictionary=values, key=string_2)
string_3 = StringInput("z")
valueAtKey_4 = DesignScript.Builtin.Dictionary.ValueAtKey(dictionary=values, key=string_3)
byCoordinates = Point.ByCoordinates(x=valueAtKey_2, y=valueAtKey_3, z=valueAtKey_4)
byCorners = Cuboid.ByCorners(highPoint=byCoordinates)

# group: Get Bookcase Data
code_block_2 = CodeBlock { "bookcases"; }
valueAtKey_5 = DesignScript.Builtin.Dictionary.ValueAtKey(dictionary=toDictionary, key=code_block_2)
values_2 = DesignScript.Builtin.Dictionary.Values(dictionary=valueAtKey_5)

# group: Build Dictionary of Bookcase CoordinateSystems
code_block_3 = CodeBlock()
# ---------- code_block_3.designscript (10 lines) ----------
[
"csOriginX",
"csOriginY",
"csOriginZ",
"csXAxisX",
"csXAxisY",
"csYAxisX",
"csYAxisY",
"id"
];
# ----------------------------------------
valueAtKey_6 = DesignScript.Builtin.Dictionary.ValueAtKey(dictionary=values_2, key=code_block_3, lacing=CrossProduct)
transpose = List.Transpose(lists=valueAtKey_6)
code_block_4 = CodeBlock(x=transpose) { x[0]; x[1]; x[2]; x[3]; x[4]; x[5]; x[6]; x[7]; }
string_from_object = FromObject(obj=code_block_4.out7)
byCoordinates_2 = Point.ByCoordinates(x=code_block_4.out0, y=code_block_4.out1, z=code_block_4.out2)
byCoordinates_3 = Vector.ByCoordinates(x=code_block_4.out3, y=code_block_4.out4)
byCoordinates_4 = Vector.ByCoordinates(x=code_block_4.out5, y=code_block_4.out6)
byOriginVectors = CoordinateSystem.ByOriginVectors(origin=byCoordinates_2, xAxis=byCoordinates_3, yAxis=byCoordinates_4)
byKeysValues = DesignScript.Builtin.Dictionary.ByKeysValues(keys=string_from_object, values=byOriginVectors)

# group: Move Bins To Bookcase
string_4 = StringInput("xpos")
valueAtKey_7 = DesignScript.Builtin.Dictionary.ValueAtKey(dictionary=values, key=string_4)
string_5 = StringInput("ypos")
valueAtKey_8 = DesignScript.Builtin.Dictionary.ValueAtKey(dictionary=values, key=string_5)
string_6 = StringInput("zpos")
valueAtKey_9 = DesignScript.Builtin.Dictionary.ValueAtKey(dictionary=values, key=string_6)
translate = Geometry.Translate(geometry=byCorners, xTranslation=valueAtKey_7, yTranslation=valueAtKey_8, zTranslation=valueAtKey_9)
string_7 = StringInput("bookcase")
valueAtKey_10 = DesignScript.Builtin.Dictionary.ValueAtKey(dictionary=values, key=string_7)
string_from_object_2 = FromObject(obj=valueAtKey_10)
valueAtKey_11 = DesignScript.Builtin.Dictionary.ValueAtKey(dictionary=byKeysValues, key=string_from_object_2)
transform = Geometry.Transform(geometry=translate, cs=valueAtKey_11)
string_8 = StringInput("priority")
valueAtKey_12 = DesignScript.Builtin.Dictionary.ValueAtKey(dictionary=values, key=string_8)

# group: Colour Dictionary for Sequence Number
color_palette = ColorPalette({R: 173, G: 255, B: 47, A: 255})
color_palette_2 = ColorPalette({R: 255, G: 215, B: 0, A: 255})
color_palette_3 = ColorPalette({R: 255, G: 0, B: 0, A: 255})
list_create = List.Create(item0=color_palette, item1=color_palette_2, item2=color_palette_3)
count = List.Count(list=list_create)
code_block_5 = CodeBlock(x=count) { 0..1..#x; }
code_block_6 = CodeBlock { 0; }
maximumItem = List.MaximumItem(list=valueAtKey_12)
map = Math.Map(rangeMin=code_block_6, rangeMax=maximumItem, inputValue=valueAtKey_12)
color_range = ColorRange(colors=list_create, indices=code_block_5, value=map)
components = Color.Components(c=color_range)

# group: Override Bin Colour
code_block_7 = CodeBlock { 100; }
byARGB = Color.ByARGB(a=code_block_7, r=components.r, g=components.g, b=components.b)
byGeometryColor = Modifiers.GeometryColor.ByGeometryColor(geometry=transform, color=byARGB)

# group: Get Book Data
code_block_8 = CodeBlock { "books"; }
valueAtKey_13 = DesignScript.Builtin.Dictionary.ValueAtKey(dictionary=toDictionary, key=code_block_8)

# group: JsonData
values_3 = DesignScript.Builtin.Dictionary.Values(dictionary=valueAtKey_13)

# group: Get Book Dimensions
code_block_9 = CodeBlock()
# ---------- code_block_9.designscript (13 lines) ----------
[
"containerId",
"packDimX",
"packDimY",
"packDimZ",
"coordX",
"coordY",
"coordZ",
"id",
"score",
"group",
"sequence"
];
# ----------------------------------------
valueAtKey_14 = DesignScript.Builtin.Dictionary.ValueAtKey(dictionary=values_3, key=code_block_9, lacing=CrossProduct)
transpose_2 = List.Transpose(lists=valueAtKey_14)
code_block_10 = CodeBlock(x=transpose_2) { x[0]; x[1]; x[2]; x[3]; x[4]; x[5]; x[6]; x[7]; x[8]; x[9]; x[10]; }

# group: Points and Vector for Placement
byCoordinates_5 = Point.ByCoordinates(x=code_block_10.out4, y=code_block_10.out5, z=code_block_10.out6)
byCoordinates_6 = Vector.ByCoordinates(x=code_block_10.out1, y=code_block_10.out2, z=code_block_10.out3)
add = Point.Add(point=byCoordinates_5, vectorToAdd=byCoordinates_6)

# group: Placed Books
byCorners_2 = Cuboid.ByCorners(lowPoint=byCoordinates_5, highPoint=add)

# group: Get Container Details from Dictionary
string_from_object_3 = FromObject(obj=code_block_10.out0)
valueAtKey_15 = DesignScript.Builtin.Dictionary.ValueAtKey(dictionary=valueAtKey, key=string_from_object_3)

# group: Move Books to Bookcases
string_9 = StringInput("xpos")
valueAtKey_16 = DesignScript.Builtin.Dictionary.ValueAtKey(dictionary=valueAtKey_15, key=string_9)
string_10 = StringInput("ypos")
valueAtKey_17 = DesignScript.Builtin.Dictionary.ValueAtKey(dictionary=valueAtKey_15, key=string_10)
string_11 = StringInput("zpos")
valueAtKey_18 = DesignScript.Builtin.Dictionary.ValueAtKey(dictionary=valueAtKey_15, key=string_11)
translate_2 = Geometry.Translate(geometry=byCorners_2, xTranslation=valueAtKey_16, yTranslation=valueAtKey_17, zTranslation=valueAtKey_18)
string_12 = StringInput("bookcase")
valueAtKey_19 = DesignScript.Builtin.Dictionary.ValueAtKey(dictionary=valueAtKey_15, key=string_12)
string_from_object_4 = FromObject(obj=valueAtKey_19)
valueAtKey_20 = DesignScript.Builtin.Dictionary.ValueAtKey(dictionary=byKeysValues, key=string_from_object_4)
transform_2 = Geometry.Transform(geometry=translate_2, cs=valueAtKey_20)

code_block_11 = CodeBlock(score=code_block_10.out8, group=code_block_10.out9, sequence=code_block_10.out10) { [score, group, sequence]; }

# group: Select Type
# note: 0 Score
# 1 Group
# 2 Sequence
number_slider = DoubleSlider(1, range=0..2 step 1)

getItemAtIndex = List.GetItemAtIndex(list=code_block_11, index=number_slider)

# group: Override Bin Edges
edges = Topology.Edges(topology=transform)
curveGeometry = Edge.CurveGeometry(edge=edges)
code_block_12 = CodeBlock { 100; }
byARGB_2 = Color.ByARGB(a=code_block_12)
byGeometryColor_2 = Modifiers.GeometryColor.ByGeometryColor(geometry=curveGeometry, color=byARGB_2)

# group: Get Unplaced Book Data
code_block_13 = CodeBlock { "unpacked"; }
valueAtKey_21 = DesignScript.Builtin.Dictionary.ValueAtKey(dictionary=toDictionary, key=code_block_13)

# group: JsonData
values_4 = DesignScript.Builtin.Dictionary.Values(dictionary=valueAtKey_21)

# group: Sort by Packing Group
code_block_14 = CodeBlock { "group"; }
valueAtKey_22 = DesignScript.Builtin.Dictionary.ValueAtKey(dictionary=values_4, key=code_block_14)
sortByKey = List.SortByKey(list=values_4, keys=valueAtKey_22)

# group: Get Book Dimensions
code_block_15 = CodeBlock()
# ---------- code_block_15.designscript (8 lines) ----------
[
"id",
"dimX",
"dimY",
"dimZ",
"score",
"group"
];
# ----------------------------------------
valueAtKey_23 = DesignScript.Builtin.Dictionary.ValueAtKey(dictionary=sortByKey.sorted_list, key=code_block_15, lacing=CrossProduct)
transpose_3 = List.Transpose(lists=valueAtKey_23)
code_block_16 = CodeBlock(x=transpose_3) { x[0]; x[1]; x[2]; x[3]; x[4]; x[5]; }

# group: Miscellany
runningTotal = Miscellany.Maths.RunningTotal(list=code_block_16.out1)

# group: Points and Vector for Placement
code_block_17 = CodeBlock(a=runningTotal, b=code_block_16.out1) { a-b; }
byCoordinates_7 = Point.ByCoordinates(x=code_block_17)
byCoordinates_8 = Point.ByCoordinates(x=runningTotal, y=code_block_16.out2, z=code_block_16.out3)

# group: Unplaced Books
byCorners_3 = Cuboid.ByCorners(lowPoint=byCoordinates_7, highPoint=byCoordinates_8)

# group: Combine Placed and Unplaced Items
list_create_2 = List.Create(item0=values_3, item1=values_4)
flatten = List.Flatten(list=list_create_2)

# group: Sort by Packing Group
code_block_18 = CodeBlock { "group"; }
valueAtKey_24 = DesignScript.Builtin.Dictionary.ValueAtKey(dictionary=flatten, key=code_block_18)
sortByKey_2 = List.SortByKey(list=flatten, keys=valueAtKey_24)

# group: Get Book Dimensions
code_block_19 = CodeBlock()  # same code as code_block_15
valueAtKey_25 = DesignScript.Builtin.Dictionary.ValueAtKey(dictionary=sortByKey_2.sorted_list, key=code_block_19, lacing=CrossProduct)
transpose_4 = List.Transpose(lists=valueAtKey_25)
code_block_20 = CodeBlock(x=transpose_4) { x[0]; x[1]; x[2]; x[3]; x[4]; x[5]; }

# group: Miscellany
runningTotal_2 = Miscellany.Maths.RunningTotal(list=code_block_20.out1)

# group: Variables for Positioning Unplaced Items
max_length_of_rows_of_unplaced = DoubleInput(2500)  # "Max Length of Rows of Unplaced Items"
x_offset = DoubleInput(4000)
y_offset = DoubleInput(1000)
y_spacing = DoubleInput(500)

# group: Process Positions
mod = runningTotal_2 % max_length_of_rows_of_unplaced
code_block_21 = CodeBlock(i=y_offset, a=runningTotal_2, b=mod, s=max_length_of_rows_of_unplaced, y=y_spacing) { i+((a-b)/s*y); }

# group: Points and Vector for Placement
code_block_22 = CodeBlock(a=mod, b=code_block_20.out1, x=x_offset) { a-b+x; }
byCoordinates_9 = Point.ByCoordinates(x=code_block_22, y=code_block_21)
code_block_23 = CodeBlock(a=mod, x=x_offset) { a+x; }
code_block_24 = CodeBlock(a=code_block_20.out2, y=code_block_21) { a+y; }
byCoordinates_10 = Point.ByCoordinates(x=code_block_23, y=code_block_24, z=code_block_20.out3)

# group: All Books
byCorners_4 = Cuboid.ByCorners(lowPoint=byCoordinates_9, highPoint=byCoordinates_10)

code_block_25 = CodeBlock(id=code_block_20.out0, score=code_block_20.out4, group=code_block_20.out5, books=byCorners_4) { id; score; group; books; }

# group: Override Book Edges
edges_2 = Topology.Edges(topology=transform_2)
curveGeometry_2 = Edge.CurveGeometry(edge=edges_2)
code_block_26 = CodeBlock { 200; }
byARGB_3 = Color.ByARGB(a=code_block_26)
byGeometryColor_3 = Modifiers.GeometryColor.ByGeometryColor(geometry=curveGeometry_2, color=byARGB_3)
edges_3 = Topology.Edges(topology=code_block_25.books)
curveGeometry_3 = Edge.CurveGeometry(edge=edges_3)
byGeometryColor_4 = Modifiers.GeometryColor.ByGeometryColor(geometry=curveGeometry_3, color=byARGB_3)

code_block_27 = CodeBlock(score=code_block_25.score, group=code_block_25.group, sequence=code_block_10.out10) { [score, group, sequence]; }
getItemAtIndex_2 = List.GetItemAtIndex(list=code_block_27, index=number_slider)

# group: Normalize Range for
code_block_28 = CodeBlock { 0; 1; }
maximumItem_2 = List.MaximumItem(list=getItemAtIndex)
lt = maximumItem_2 < code_block_28.out1
if_ = If(test=lt, true=code_block_28.out1, false=maximumItem_2)
map_2 = Math.Map(rangeMin=code_block_28.out0, rangeMax=if_, inputValue=getItemAtIndex)
map_3 = Math.Map(rangeMin=code_block_28.out0, rangeMax=if_, inputValue=getItemAtIndex_2)

# group: Dictionary of Colours for Scores
color_palette_4 = ColorPalette({R: 0, G: 0, B: 139, A: 255})
color_palette_5 = ColorPalette({R: 34, G: 139, B: 34, A: 255})
color_palette_6 = ColorPalette({R: 255, G: 0, B: 0, A: 255})
color_palette_7 = ColorPalette({R: 127, G: 255, B: 0, A: 255})
list_create_3 = List.Create(item0=color_palette_6, item1=color_palette_7)
count_2 = List.Count(list=list_create_3)
code_block_29 = CodeBlock(x=count_2) { 0..1..#x; }
color_range_2 = ColorRange(colors=list_create_3, indices=code_block_29, value=map_2)
color_palette_8 = ColorPalette({R: 100, G: 149, B: 237, A: 255})
color_palette_9 = ColorPalette({R: 255, G: 105, B: 180, A: 255})
color_range_3 = ColorRange(colors=list_create_3, indices=code_block_29, value=map_3)

# group: Colour Dictionary for Groups
color_palette_10 = ColorPalette({R: 255, G: 0, B: 0, A: 255})
color_palette_11 = ColorPalette({R: 50, G: 205, B: 50, A: 255})
color_palette_12 = ColorPalette({R: 0, G: 0, B: 255, A: 255})
list_create_4 = List.Create(item0=color_palette_10, item1=color_palette_11, item2=color_palette_12)
count_3 = List.Count(list=list_create_4)
code_block_30 = CodeBlock(x=count_3) { 0..1..#x; }
color_range_4 = ColorRange(colors=list_create_4, indices=code_block_30, value=map_2)
color_range_5 = ColorRange(colors=list_create_4, indices=code_block_30, value=map_3)

# group: Colour Dictionary for Sequence Number
color_palette_13 = ColorPalette({R: 255, G: 0, B: 0, A: 255})
color_palette_14 = ColorPalette({R: 0, G: 0, B: 255, A: 255})
list_create_5 = List.Create(item0=color_palette_13, item1=color_palette_14)
count_4 = List.Count(list=list_create_5)
code_block_31 = CodeBlock(x=count_4) { 0..1..#x; }
color_range_6 = ColorRange(colors=list_create_5, indices=code_block_31, value=map_2)
# note: Grey for Not Placed Books (No Sequence Number
color_palette_15 = ColorPalette({R: 211, G: 211, B: 211, A: 255})

# group: Select Range
code_block_32 = CodeBlock(a=color_range_2, b=color_range_4, c=color_range_6) { [a,b,c]; }
getItemAtIndex_3 = List.GetItemAtIndex(list=code_block_32, index=number_slider)
code_block_33 = CodeBlock(a=color_range_3, b=color_range_5, c=color_palette_15) { [a,b,c]; }
getItemAtIndex_4 = List.GetItemAtIndex(list=code_block_33, index=number_slider)

# group: Override Colour for Item in Dynamo
byGeometryColor_5 = Modifiers.GeometryColor.ByGeometryColor(geometry=transform_2, color=getItemAtIndex_3)
byGeometryColor_6 = Modifiers.GeometryColor.ByGeometryColor(geometry=code_block_25.books, color=getItemAtIndex_4)

# group: Get Bookcase Instances from Revit File
code_block_34 = CodeBlock()
# ---------- code_block_34.designscript (5 lines) ----------
[
"id",
"Revit Family Name",
"Revit Type Name"
];
# ----------------------------------------
valueAtKey_26 = DesignScript.Builtin.Dictionary.ValueAtKey(dictionary=values_2, key=code_block_34, lacing=CrossProduct)
transpose_5 = List.Transpose(lists=valueAtKey_26)
code_block_35 = CodeBlock(x=transpose_5) { x[0]; x[1]; x[2]; }
byFamilyNameAndTypeName = FamilyType.ByFamilyNameAndTypeName(familyName=code_block_35.out1, typeName=code_block_35.out2)
byFamilyType = FamilyInstance.ByFamilyType(familyType=byFamilyNameAndTypeName)
string_from_object_5 = FromObject(obj=code_block_35.out0)
code_block_36 = CodeBlock { "Mark"; }
getParameterValueByName = Element.GetParameterValueByName(element=byFamilyType, parameterName=code_block_36)
eq = string_from_object_5 == getParameterValueByName
filterByBoolMask = List.FilterByBoolMask(list=byFamilyType, mask=eq)
flatten_2 = List.Flatten(list=filterByBoolMask.in)

# group: Shelf Family and Type Names
string_13 = StringInput("Shelf-Flexible")
string_14 = StringInput("Shelf-None")

# group: Get Shelf Families by Name
byFamilyNameAndTypeName_2 = FamilyType.ByFamilyNameAndTypeName(familyName=string_13, typeName=string_13)
byFamilyNameAndTypeName_3 = FamilyType.ByFamilyNameAndTypeName(familyName=string_14, typeName=string_14)

# group: Get Parameters for Shelves
code_block_37 = CodeBlock { "shelves"; }
valueAtKey_27 = DesignScript.Builtin.Dictionary.ValueAtKey(dictionary=values_2, key=code_block_37)
values_5 = DesignScript.Builtin.Dictionary.Values(dictionary=valueAtKey_27)
code_block_38 = CodeBlock { "shelfParam"; }
valueAtKey_28 = DesignScript.Builtin.Dictionary.ValueAtKey(dictionary=values_5, key=code_block_38)
code_block_39 = CodeBlock { "shelfType"; }
valueAtKey_29 = DesignScript.Builtin.Dictionary.ValueAtKey(dictionary=values_5, key=code_block_39)
eq_2 = valueAtKey_29 == string_13
filterByBoolMask_2 = List.FilterByBoolMask(list=valueAtKey_28, mask=eq_2)
code_block_40 = CodeBlock { "use"; }
valueAtKey_30 = DesignScript.Builtin.Dictionary.ValueAtKey(dictionary=values_5, key=code_block_40)
filterByBoolMask_3 = List.FilterByBoolMask(list=valueAtKey_30, mask=eq_2)
code_block_41 = CodeBlock(b=filterByBoolMask_3.in, famFlexible=byFamilyNameAndTypeName_2, famNone=byFamilyNameAndTypeName_3) { b?famFlexible:famNone; }

# group: Set Flexible Shelf Families for Packing Result
setParameterByName = Element.SetParameterByName(element=flatten_2, parameterName=filterByBoolMask_2.in, value=code_block_41)
end = Revit.Transaction.Transaction.End(input=setParameterByName)

# group: Prepare for Revit
categories = Categories(index=222)
string_15 = StringInput("Default")
byName = Material.ByName(name=string_15)

# group: DirectShape Name
code_block_42 = CodeBlock(s=code_block_10.out7) { "Book " + s; }

# group: Views to Override
views = Views(index=3)
views_2 = Views(index=4)
views_3 = Views(index=5)
views_4 = Views(index=6)
list_create_6 = List.Create(item0=views, item1=views_2, item2=views_3, item3=views_4)

# group: Override Settings
color_palette_16 = ColorPalette({R: 0, G: 0, B: 0, A: 255})
fill_patterns = FillPatterns(index=0)

# group: DirectShape Name
code_block_43 = CodeBlock(s=code_block_25.id) { "Unplaced Book " + s; }

# group: Springnodes DirectShape to Revit
byGeometry = Custom[Springs.BrepShape.ByGeometry](geometry=transform_2, category=categories, name=code_block_42, material=byName)  # Convert the input geometry to DirectShape element inside the Revit document. Works only in Revit 2017 and later. Usies the more advanced BrepBuilder. It supports solids or surfaces, however periodic faces like spheres, cylinders and cones are not supported. Each created DS will have a unique type. Make sure that each input geometry has a unique name. You can either feed a single category and material for all geometries or a unique one for each geometry - the node's lacing is set to longest by default. The default category is Generic Model.
byGeometry_2 = Custom[Springs.BrepShape.ByGeometry](geometry=code_block_25.books, category=categories, name=code_block_43, material=byName)

# group: Override Color in MultipleViews
override_placed_books = Python(IN[0]=byGeometry, IN[1]=list_create_6, IN[2]=getItemAtIndex_3, IN[3]=color_palette_16, IN[4]=fill_patterns)
# ---------- override_placed_books.python (46 lines) ----------
# Enable Python support and load DesignScript library
import clr
clr.AddReference('ProtoGeometry')
from Autodesk.DesignScript.Geometry import *

# Import DocumentManager and TransactionManager
clr.AddReference("RevitServices")
import RevitServices
from RevitServices.Persistence import DocumentManager
from RevitServices.Transactions import TransactionManager
doc = DocumentManager.Instance.CurrentDBDocument
uidoc = DocumentManager.Instance.CurrentUIApplication.ActiveUIDocument

# Import Element wrapper extension methods
import clr
clr.AddReference("RevitNodes")
import Revit
clr.ImportExtensions(Revit.Elements)

# Import RevitAPI
clr.AddReference("RevitAPI")
import Autodesk
from Autodesk.Revit.DB import *

import System
from System.Collections.Generic import *

items = UnwrapElement(IN[0])
views = UnwrapElement(IN[1])
fillColours = UnwrapElement(IN[2])
lineColour = UnwrapElement(IN[3])
pattern = UnwrapElement(IN[4])

ogs = OverrideGraphicSettings()
ogs.SetProjectionLineColor(Color(lineColour.Red, lineColour.Green, lineColour.Blue))
ogs.SetProjectionFillPatternId(pattern.Id)

for i, c in zip(items, fillColours):
	TransactionManager.Instance.EnsureInTransaction(doc)
	ogs.SetProjectionFillColor(Color(c.Red, c.Green, c.Blue))
	for view in views:
		view.SetElementOverrides(i.Id, ogs)
	TransactionManager.Instance.TransactionTaskDone()

# Assign your output to the OUT variable.
OUT = items
# ----------------------------------------
# note: 0	items (iterable)
# 1	views (iterable)
# 2	fillColours (iterable)
# 3	lineColour (singleton)
# 4	pattern (singleton)
override_unplaced_books = Python(IN[0]=byGeometry_2, IN[1]=list_create_6, IN[2]=getItemAtIndex_4, IN[3]=color_palette_16, IN[4]=fill_patterns)  # same code as override_placed_books
wait_for_overrides_to_complete = CodeBlock(o1=override_placed_books, o2=override_unplaced_books, items=byGeometry) { [o1,o2,items][2]; }

code_block_44 = CodeBlock(seq=code_block_10.out10) { seq; }

# group: Sheets or Views to Export
views_5 = Views(index=32)
views_6 = Views(index=33)
list_create_7 = List.Create(item0=views_5, item1=views_6)

# group: Image Export Variables
image_width = DoubleInput(1500)
directory_path = Directory("C:\Users\Thomas.corrie\Box Sync\Library\ImageExports\Test")
boolean = BoolSelector(true)
boolean_2 = BoolSelector(true)

# group: Get Pack Name
code_block_45 = CodeBlock { "result"; }
valueAtKey_31 = DesignScript.Builtin.Dictionary.ValueAtKey(dictionary=toDictionary, key=code_block_45)
code_block_46 = CodeBlock { "packName"; }
valueAtKey_32 = DesignScript.Builtin.Dictionary.ValueAtKey(dictionary=valueAtKey_31, key=code_block_46)

code_block_47 = CodeBlock(group=code_block_10.out9) { group; }
code_block_48 = CodeBlock(score=code_block_10.out8) { score; }

# group: Animate Sequence
# note: Incorporates scripts from Archi-Lab Export Image by View and View.Hide Elements
# note: 0	items
# 1	sequence
# 2	views
# 3	sheets
# 4	imageWidth
# 5	pathExport
# 6	packName
# 7	group
# 8	score
# 9	unplaced items
python_script = Python(IN[0]=wait_for_overrides_to_complete, IN[1]=code_block_44, IN[2]=list_create_6, IN[3]=list_create_7, IN[4]=image_width, IN[5]=directory_path, IN[6]=valueAtKey_32, IN[7]=code_block_47, IN[8]=code_block_48, IN[9]=code_block_43)  # frozen
# ---------- python_script.python (209 lines) ----------
# Adapted form Archi-Lab nodes View.HideElements, View.UnhideElements
# Enable Python support and load DesignScript library
import clr
clr.AddReference('ProtoGeometry')
from Autodesk.DesignScript.Geometry import *

# Import DocumentManager and TransactionManager
clr.AddReference("RevitServices")
import RevitServices
from RevitServices.Persistence import DocumentManager
from RevitServices.Transactions import TransactionManager
doc = DocumentManager.Instance.CurrentDBDocument
uidoc = DocumentManager.Instance.CurrentUIApplication.ActiveUIDocument

# Guids
from System import Guid

# Import Element wrapper extension methods
import clr
clr.AddReference("RevitNodes")
import Revit
clr.ImportExtensions(Revit.Elements)

# Import RevitAPI
clr.AddReference("RevitAPI")
import Autodesk
from Autodesk.Revit.DB import *

# Import System
import System
from System.Collections.Generic import *

#itertools
from itertools import groupby
from operator import itemgetter

# Import os
import sys
sys.path.append(r'C:\Program Files (x86)\IronPython 2.7\Lib')
import os
import glob

def HideElement(view, item):
	if not item.IsHidden(view) and item.CanBeHidden(view):
		ids = List[ElementId]()
		ids.Add(item.Id)
		view.HideElements(ids)
	return None
	
def UnhideElement(view, item):
	if item.IsHidden(view):
		ids = List[ElementId]()
		ids.Add(item.Id)
		view.UnhideElements(ids)
	return None
	
def HideElements(view, items):
	ids = List[ElementId]()
	for item in items:
		if not item.IsHidden(view) and item.CanBeHidden(view):
			ids.Add(item.Id)
	if len(ids) > 0:
		view.HideElements(ids)
	return None
	
def UnhideElements(view, items):
	ids = List[ElementId]()
	for item in items:
		if item.IsHidden(view):
			ids.Add(item.Id)
	if len(ids) > 0:
		view.UnhideElements(ids)
	return None
	
def Rename(count, sheet):
	sheet.Name
	list_of_files = glob.glob(imagePath + '\\*' + sheet.Name + '*') 
	latest_file = max(list_of_files, key=os.path.getctime)
	os.rename(latest_file, imagePath + '\\' + sheet.Name + '-' + str(count) + '.png')
	return None

items = UnwrapElement(IN[0])
sequence = IN[1]
views = UnwrapElement(IN[2])
sheets = UnwrapElement(IN[3])
imageWidth = IN[4]
pathExport = IN[5]
packName = IN[6]
groups = IN[7]
scores = IN[8]

# Create export list of views and sheets
sheetIds = List[ElementId]()
for sheet in sheets:
	sheetIds.Add(sheet.Id)

# Image Export Options
imagePath = pathExport
iOpt = ImageExportOptions()
iOpt.FilePath = imagePath
iOpt.ExportRange = ExportRange.SetOfViews
iOpt.SetViewsAndSheets(sheetIds)
iOpt.HLRandWFViewsFileType = ImageFileType.PNG
iOpt.ShadowViewsFileType = ImageFileType.PNG
iOpt.PixelSize = imageWidth

# Sheet Comments Parameter
guid = Guid('c42a315f-86f2-4f7d-bb8f-652afde0b23b')

# GROUP IMAGES
sortedItemsGroup = [x for y, x in sorted(zip(groups,items))]
sortedGroups = sorted(groups)
groupItems = []
groupKeys = []
for k, group in groupby(zip(sortedGroups, sortedItemsGroup), itemgetter(0)):
	groupItems.append([])
	groupKeys.append(k)
	for g in group:
		groupItems[-1].append(g[1])
		
for k, g in zip(groupKeys, groupItems):
	TransactionManager.Instance.EnsureInTransaction(doc)
	for view in views:
		HideElements(view,items)
		UnhideElements(view, g)
	for sheet in sheets:
		param = sheet.get_Parameter(guid)
		param.Set('Group: ' + str(k))
	iOpt.FilePath = imagePath + '\\Group_' + str(k)		
	doc.Regenerate() # just calling uidoc.RefreshActiveView() didn't do the trick
	doc.ExportImage(iOpt)
	TransactionManager.Instance.TransactionTaskDone()
	
# SCORE IMAGES
sortedItemsScore = [x for y, x in sorted(zip(scores,items))]
sortedScores = sorted(scores)
scoreItems = []
scoreKeys = []
for k, group in groupby(zip(sortedScores, sortedItemsScore), itemgetter(0)):
	scoreItems.append([])
	scoreKeys.append(k)
	for g in group:
		scoreItems[-1].append(g[1])
		
for k, g in zip(scoreKeys, scoreItems):
	TransactionManager.Instance.EnsureInTransaction(doc)
	for view in views:
		HideElements(view,items)
		UnhideElements(view, g)
	for sheet in sheets:
		param = sheet.get_Parameter(guid)
		param.Set('Score: ' + str(k))
	iOpt.FilePath = imagePath + '\\Score_' + str(k*100)		
	doc.Regenerate() # just calling uidoc.RefreshActiveView() didn't do the trick
	doc.ExportImage(iOpt)
	TransactionManager.Instance.TransactionTaskDone()


# Ensure all items are hidden
for v in views: 
	TransactionManager.Instance.EnsureInTransaction(doc)
	HideElements(v,items)
	doc.Regenerate()
	TransactionManager.Instance.TransactionTaskDone()
	
# Export Initial Image
TransactionManager.Instance.EnsureInTransaction(doc)
for sheet in sheets:
	param = sheet.get_Parameter(guid)
	param.Set('')
doc.Regenerate()
iOpt.FilePath = imagePath + '\\0'
doc.ExportImage(iOpt)
TransactionManager.Instance.TransactionTaskDone()
for sheet in sheets:
	Rename(0,sheet)
	
# Sort items by sequence and reverse the list 
sortedItems = [x for y, x in sorted(zip(sequence,items))]

# Loop through items in order
out = []
total = len(sortedItems)
count = 1
for item in sortedItems[0:2]:
	TransactionManager.Instance.EnsureInTransaction(doc)
	for view in views:
		UnhideElement(view, item)
	iOpt.FilePath = imagePath + '\\' + str(count)
	for sheet in sheets:
		param = sheet.get_Parameter(guid)
		param.Set('Book ' + str(count) + ' / ' + str(total))		
	doc.Regenerate() # just calling uidoc.RefreshActiveView() didn't do the trick
	doc.ExportImage(iOpt)
	for sheet in sheets:
		Rename(count,sheet)
	TransactionManager.Instance.TransactionTaskDone()
	out.append(item)
	count = count + 1

# Ensure all items are unhidden
for v in views: 
	TransactionManager.Instance.EnsureInTransaction(doc)
	UnhideElements(v,items)
	doc.Regenerate()
	TransactionManager.Instance.TransactionTaskDone()

# Assign your output to the OUT variable.
OUT = out
# ----------------------------------------

# group: Write Scenario Details to Project Information
categories_2 = Categories(index=368)
all_elements_of_category = ElementsOfCategory(Category=categories_2)
firstItem = List.FirstItem(list=all_elements_of_category)
code_block_49 = CodeBlock()
# ---------- code_block_49.designscript (8 lines) ----------
[
"Library_Scenario",
"Library_Result",
"Library_Score",
"Library_PackedBooks",
"Library_UnpackedBooks",
"Library_TotalBooks"
];
# ----------------------------------------

# group: Get Details
code_block_50 = CodeBlock()
# ---------- code_block_50.designscript (8 lines) ----------
[
"scenarioName",
"packName",
"meanScore",
"numBooksPacked",
"numBooksNotPacked",
"numBooksTotal"
];
# ----------------------------------------
valueAtKey_33 = DesignScript.Builtin.Dictionary.ValueAtKey(dictionary=valueAtKey_31, key=code_block_50)

# group: Set Project Information Parameters
setParameterByName_2 = Element.SetParameterByName(element=firstItem, parameterName=code_block_49, value=valueAtKey_33)

# group: Animate Sequence
# note: Incorporates scripts from Archi-Lab Export Image by View and View.Hide Elements
# note: 0	items
# 1	sequence
# 2	views
# 3	sheets
# 4	imageWidth
# 5	pathExport
# 6	packName
# 7	group
# 8	score
# 9	unplaced items
# 10	unplaced item ids
# 11	run group images?
# 12	run score images?
python_script_2 = Python(IN[0]=wait_for_overrides_to_complete, IN[1]=code_block_44, IN[2]=list_create_6, IN[3]=list_create_7, IN[4]=image_width, IN[5]=directory_path, IN[6]=valueAtKey_32, IN[7]=code_block_47, IN[8]=code_block_48, IN[9]=byGeometry_2, IN[10]=code_block_25.id, IN[11]=boolean, IN[12]=boolean_2)  # frozen
# ---------- python_script_2.python (235 lines) ----------
# Adapted form Archi-Lab nodes View.HideElements, View.UnhideElements
# Enable Python support and load DesignScript library
import clr
clr.AddReference('ProtoGeometry')
from Autodesk.DesignScript.Geometry import *

# Import DocumentManager and TransactionManager
clr.AddReference("RevitServices")
import RevitServices
from RevitServices.Persistence import DocumentManager
from RevitServices.Transactions import TransactionManager
doc = DocumentManager.Instance.CurrentDBDocument
uidoc = DocumentManager.Instance.CurrentUIApplication.ActiveUIDocument

# Guids
from System import Guid

# Import Element wrapper extension methods
import clr
clr.AddReference("RevitNodes")
import Revit
clr.ImportExtensions(Revit.Elements)

# Import RevitAPI
clr.AddReference("RevitAPI")
import Autodesk
from Autodesk.Revit.DB import *

# Import System
import System
from System.Collections.Generic import *

#itertools
from itertools import groupby
from operator import itemgetter

# Import os
import sys
sys.path.append(r'C:\Program Files (x86)\IronPython 2.7\Lib')
import os
import glob

def HideElement(view, item):
	if not item.IsHidden(view) and item.CanBeHidden(view):
		ids = List[ElementId]()
		ids.Add(item.Id)
		view.HideElements(ids)
	return None
	
def UnhideElement(view, item):
	if item.IsHidden(view):
		ids = List[ElementId]()
		ids.Add(item.Id)
		view.UnhideElements(ids)
	return None
	
def HideElements(view, items):
	ids = List[ElementId]()
	for item in items:
		if not item.IsHidden(view) and item.CanBeHidden(view):
			ids.Add(item.Id)
	if len(ids) > 0:
		view.HideElements(ids)
	return None
	
def UnhideElements(view, items):
	ids = List[ElementId]()
	for item in items:
		if item.IsHidden(view):
			ids.Add(item.Id)
	if len(ids) > 0:
		view.UnhideElements(ids)
	return None
	
def Rename(prefix,count,sheet):
	list_of_files = glob.glob(imagePath + '\\*' + sheet.Name + '*') 
	latest_file = max(list_of_files, key=os.path.getctime)
	file_rename = imagePath + '\\' + prefix + '-' + sheet.Name + '-' + str(count) + '.png'
	try:
		os.rename(latest_file, file_rename)
	except: # File already exists
		os.remove(file_rename)
		os.rename(latest_file, file_rename)
	return None

items = UnwrapElement(IN[0])
sequence = IN[1]
views = UnwrapElement(IN[2])
sheets = UnwrapElement(IN[3])
imageWidth = IN[4]
pathExport = IN[5]
packName = IN[6]
groups = IN[7]
scores = IN[8]
unplacedItems = UnwrapElement(IN[9])
unplacedItemsIds = IN[10]
runGroupImages = IN[11]
runScoreImages = IN[12]

# Create export list of views and sheets
sheetIds = List[ElementId]()
for sheet in sheets:
	sheetIds.Add(sheet.Id)

# Image Export Options
imagePath = pathExport
iOpt = ImageExportOptions()
iOpt.FilePath = imagePath
iOpt.ExportRange = ExportRange.SetOfViews
iOpt.SetViewsAndSheets(sheetIds)
iOpt.HLRandWFViewsFileType = ImageFileType.PNG
iOpt.ShadowViewsFileType = ImageFileType.PNG
iOpt.PixelSize = imageWidth

# Sheet Comments Parameter
guid = Guid('c42a315f-86f2-4f7d-bb8f-652afde0b23b')

# Hide all unplaced items
for v in views: 
	TransactionManager.Instance.EnsureInTransaction(doc)
	HideElements(v,unplacedItems)
	doc.Regenerate()
	TransactionManager.Instance.TransactionTaskDone()

# GROUP IMAGES
if runGroupImages:
	sortedItemsGroup = [x for y, x in sorted(zip(groups,items))]
	sortedGroups = sorted(groups)
	groupItems = []
	groupKeys = []
	for k, group in groupby(zip(sortedGroups, sortedItemsGroup), itemgetter(0)):
		groupItems.append([])
		groupKeys.append(k)
		for g in group:
			groupItems[-1].append(g[1])
		
	for k, g in zip(groupKeys, groupItems):
		TransactionManager.Instance.EnsureInTransaction(doc)
		for view in views:
			HideElements(view,items)
			UnhideElements(view, g)
		for sheet in sheets:
			param = sheet.get_Parameter(guid)
			param.Set('Group: ' + str(k))
		iOpt.FilePath = imagePath + '\\Group_' + str(k)		
		doc.Regenerate() # just calling uidoc.RefreshActiveView() didn't do the trick
		doc.ExportImage(iOpt)
		TransactionManager.Instance.TransactionTaskDone()
		#for sheet in sheets:
			#Rename('group',str(k),sheet)
	
# SCORE IMAGES
if runScoreImages:
	sortedItemsScore = [x for y, x in sorted(zip(scores,items))]
	sortedScores = sorted(scores)
	scoreItems = []
	scoreKeys = []
	for k, group in groupby(zip(sortedScores, sortedItemsScore), itemgetter(0)):
		scoreItems.append([])
		scoreKeys.append(k)
		for g in group:
			scoreItems[-1].append(g[1])
			
	for k, g in zip(scoreKeys, scoreItems):
		TransactionManager.Instance.EnsureInTransaction(doc)
		for view in views:
			HideElements(view,items)
			UnhideElements(view, g)
		for sheet in sheets:
			param = sheet.get_Parameter(guid)
			param.Set('Score: ' + str(k))
		iOpt.FilePath = imagePath + '\\Score_' + str(k*100)		
		doc.Regenerate() # just calling uidoc.RefreshActiveView() didn't do the trick
		doc.ExportImage(iOpt)
		TransactionManager.Instance.TransactionTaskDone()
		for sheet in sheets:
			Rename('score',str(k*100),sheet)

# Ensure all placed items are hidden and unplaced items are unhidden
for v in views: 
	TransactionManager.Instance.EnsureInTransaction(doc)
	HideElements(v,items)
	UnhideElements(v,unplacedItems)
	doc.Regenerate()
	TransactionManager.Instance.TransactionTaskDone()
	
# Export Initial Image
TransactionManager.Instance.EnsureInTransaction(doc)
for sheet in sheets:
	param = sheet.get_Parameter(guid)
	param.Set('')
doc.Regenerate()
iOpt.FilePath = imagePath + '\\0'
doc.ExportImage(iOpt)
TransactionManager.Instance.TransactionTaskDone()
for sheet in sheets:
	Rename('item','0',sheet)
	
# Sort items by sequence
sortedItems = [x for y, x in sorted(zip(sequence,items))]

# Loop through items in order
out = []
ids = []
total = len(sortedItems)
count = 1
for item in sortedItems[0:10]:
	bookId = int(item.Name.split(" ")[1]) # Get id from unplaced item name
	unplacedItem = unplacedItems[unplacedItemsIds.index(bookId)] # Get unplaced item
	TransactionManager.Instance.EnsureInTransaction(doc)
	for view in views:
		UnhideElement(view, item)
		HideElement(view, unplacedItem)
	iOpt.FilePath = imagePath + '\\' + str(count)
	for sheet in sheets:
		param = sheet.get_Parameter(guid)
		param.Set('Book ' + str(count) + ' / ' + str(total))		
	doc.Regenerate() # just calling uidoc.RefreshActiveView() didn't do the trick
	doc.ExportImage(iOpt)
	for sheet in sheets:
		Rename('item',str(count),sheet)
	TransactionManager.Instance.TransactionTaskDone()
	out.append(item)
	count = count + 1

# Ensure all items are unhidden
for v in views: 
	TransactionManager.Instance.EnsureInTransaction(doc)
	UnhideElements(v,items)
	UnhideElements(v,unplacedItems)
	doc.Regenerate()
	TransactionManager.Instance.TransactionTaskDone()

# Assign your output to the OUT variable.
OUT = out, ids
# ----------------------------------------
